# Grasshopper definition PromptTesting.gh (Grasshopper 1.0.7)
# plug-ins: GHPT, CurvePlus

# Code Information: Author: Jo Kamm
# Contact: jokamm@gmail.com
# 
# Date: 6/25/23
# Project: GhPT
number_slider = Slider(21, range=0..60)
curve = Curve(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)
# Code Description: Short description of program goals
# Track version changes
# Twisty Tower
divide_curve = DivideCurve(Curve=curve, Count=number_slider, Kinks=False)  # -> Points, Tangents, Parameters
partition_list = PartitionList(List=divide_curve.Points, Size=2)
polyline = PolyLine(Vertices=partition_list, Closed=False)

# ----
# Advice: Make sure to set the number sliders to the correct value
# Please make a script that makes a circle of radius 4 at the point (10,10,0).  Generate 10 planes along the circle. Generate a sphere at each plane.
circle = CircleCNR(Normal=Vector(0, 0, 1), Radius=1)
divide = DivideCurve(Curve=circle, Count=10, Kinks=False)  # -> Points, Tangents, Parameters
pframe = PerpFrame(Curve=circle, Parameter=divide.Points)
sph = Sphere(Base=pframe, Radius=1)

# ----
# Please make a script that makes a circle of radius 4 at the point (10,10,0) with 10 planes along the circle.  At each plane, place a circle of radius 1.
# Advice: Make sure to set the number sliders to the correct values
# Please make a script that makes a circle of radius 4 at the point (10,10,0).  Generate 10 planes along the circle.
pt = Point(Point(10, 10, 0))
circle_2 = CircleCNR(Center=pt, Normal=Vector(0, 0, 1), Radius=1)
pframes = PerpFrames(Curve=circle_2, Count=10, Align=True)  # -> Frames, Parameters

# ----
# Advice: Make sure to have a set of random points for this script
# Please make a script that sorts a random set of points, first by their x value and then by their y value and draws a polyline between them.
sort_pt = SortPoints()  # -> Points, Indices
sort_pt_2 = SortPoints(Points=sort_pt.Points)  # -> Points, Indices
pline = PolyLine(Vertices=sort_pt_2.Points, Closed=False)

# ----
# Advice: Make sure to set the number sliders to the correct values
# Please make a script that makes a circle of radius 4 at the point (10,10,0) with 10 planes along the circle.
pt_2 = Point(Point(10, 10, 0))
number_slider_2 = Slider([circle_2, Slider(10, range=0..10)], 4, range=0..10)
# Advice: Exception: The JSON value could not be converted to System.String. Path: $.Additions[0].Value | LineNumber: 6 | BytePositionInLine: 13.
# Please make a script that makes a circle of radius 4 at the point (10,10,0) with 10 points along the circle.  At each point, place a circle with radius 1.
# Advice: Exception: The JSON value could not be converted to System.String. Path: $.Additions[0].Value | LineNumber: 6 | BytePositionInLine: 13.
number_slider_3 = Slider(10, range=0..10)
circle_3 = CircleCNR(Center=pt_2, Normal=Vector(0, 0, 1), Radius=number_slider_2)
divide_2 = DivideCurve(Curve=circle_3, Count=number_slider_3, Kinks=False)  # -> Points, Tangents, Parameters
pl = PlaneNormal(Origin=Point(0, 0, 0), ZAxis=Vector(0, 0, 1))

# ----
# Advice: Make sure to use the correct units for the dimensions
# Can you make a twisty tower with six sides and a radius of 6 inches that is 48 inches tall?
pt_3 = Point(Point(0, 0, 0))
# Grid
pt_4 = Point(Point(0, 0, 48))
polygon = Polygon(Plane=PlaneXY(0, 0, 0), Radius=3, Segments=6, FilletRadius=0)  # -> Polygon, Length
ln = Line(StartPoint=pt_3, EndPoint=pt_4)
Z = UnitZ(Factor=Slider(50, range=0..100))
extr = Extrude(Base=polygon.Polygon, Direction=Z)
twist = Twist(Geometry=extr, Axis=ln, Angle=Slider(4, range=0..360), Infinite=False, Rigid=False)
sunion = SolidUnion(Breps=twist)
# Rename panels to Prompt
# Add a number to each prompt
# + random Points
join = BrepJoin(Breps=sunion)  # -> Breps, Closed

# ----
# Advice: Make sure to create a sufficient number of random points for a meaningful polyline
# Please make a script that sorts a random set of points and draws a polyline between them.
number_slider_4 = Slider(100, range=0..1000)
random = Random(Range=Domain(0, 1), Number=1, Seed=number_slider_4)
sort = SortList()  # -> Keys, ValuesA
pline_2 = PolyLine(Vertices=sort.ValuesA, Closed=False)

# ----
# Advice: Make sure to set the number of points and radius of the circle using the number sliders
# Please make a script that makes a circle with 10 points along the circle.
number_slider_5 = Slider(10, range=1..20)
circle_4 = CircleCNR(Normal=Vector(0, 0, 1), Radius=number_slider_5)
divide_3 = DivideCurve(Curve=circle_4, Count=Slider(5, range=1..10), Kinks=False)  # -> Points, Tangents, Parameters

# ----
# Advice: Make sure to properly define the circle radius and number of planes using number sliders
# Please make a script that makes a circle at the origin with 10 planes along the circle.
number_slider_6 = Slider(10, range=1..50)
# Circle with Points along it
number_slider_7 = Slider(10, range=3..20)
circle_5 = CircleCNR(Normal=Vector(0, 0, 1), Radius=number_slider_6)
divide_4 = DivideCurve(Curve=circle_5, Count=number_slider_7, Kinks=False)  # -> Points, Tangents, Parameters
pframes_2 = PerpFrames(Curve=circle_5, Count=10, Align=True)  # -> Frames, Parameters

# ----
# Advice: Make sure to set the number slider to the correct value
# Please make a script that makes a circle at the point (0,0,0) with 10 planes along the circle.
pt_5 = Point(Point(0, 0, 0))
circle_6 = CircleCNR(Center=pt_5, Normal=Vector(0, 0, 1), Radius=1)
divide_5 = DivideCurve(Curve=circle_6, Count=Slider(10, range=0..20), Kinks=False)  # -> Points, Tangents, Parameters
pl_2 = PlaneNormal(Origin=Point(0, 0, 0), ZAxis=Vector(0, 0, 1))

# ----
# Advice: Make sure to properly define the cup's dimensions and handle shape using the number sliders
# Can you make a cup with a handle?
# Advice: This question is too complex for me to answer. Please try again.
# Can you make a teapot?
number_slider_8 = Slider(0.25, range=0..1)
circle_7 = CircleCNR(Normal=Vector(0, 0, 1), Radius=1)
rec = Rectangle()
swp1 = Sweep1(Rail=[rec, circle_7], Miter=1)
move = Move(Geometry=circle_7, Motion=Vector(0, 0, 10))  # -> Geometry, Transform
loft = Loft(
    Curves=[circle_7, move.Geometry],
    Options={Adjust=False, Closed=False, LoftEnds=0, LoftSimp=0, LoftType=0, Rebuild=10, Refit=0.01})
join_2 = BrepJoin(Breps=[loft, swp1])  # -> Breps, Closed

# ----
# Advice: Make sure to set the correct dimensions for the rectangle and the number of points you want
# Random Points
# Please make a script that generates a random set of points inside a rectangle of dimensions 100 by 100.
rec_2 = Rectangle()
popgeo = PopulateGeometry(Geometry=rec_2, Count=Slider(100, range=0..1000), Seed=1)

# ----
# Advice: Make sure to set the correct dimensions and radius for the grid and circles
# Can you make a grid of points with cell size of 1 by 1, and 10 by 20 units.  At each point of the grid, place a circle with a radius of 1.
number_slider_9 = Slider(1, range=0..1)
series = Series(Start=0, Step=1, Count=10)
pt_6 = Point(series)
circle_8 = CircleCNR(Normal=Vector(0, 0, 1), Radius=number_slider_9)

# ----
# Advice: Make sure to set the correct dimensions and number of points for the best results
# Please make a script that generates a random set of points inside a rectangle of dimensions 100 by 100. Create a voronoi diagram using the points
rec_3 = Rectangle()
pop2d = Populate2D(Region={Plane=PlaneXY(0, 0, 0), Size=Domain2(u=0..20, v=0..10)}, Count=[rec_3, Slider(50, range=1..100)], Seed=1)
voronoi = Voronoi(Points=pop2d, BruteForceOverride=False)

# ----
# Advice: The grid will be 10 by 10 points, with a cell size of 1 by 1
# Can you make a grid of 100 points with cell size of 1 by 1?
number_slider_10 = Slider(10, range=0..10)
# Cup and Teapot
number_slider_11 = Slider(10, range=0..10)

# ----
# Advice: Make sure the random number inputs are set within the rectangle's dimensions
# Please make a script that generates a random set of points inside a rectangle of dimensions 100 by 100.
number_slider_12 = Slider(100, range=0..100)
number_slider_13 = Slider(100, range=0..100)
random_2 = Random(Range=Domain(0, 1), Number=1, Seed=Slider(100, range=0..100))
pt_7 = ConstructPoint(XCoordinate=random_2, YCoordinate=random_2, ZCoordinate=0)

# ----
# Advice: Make sure to set the number of points and radius value
# Please make a script that generates a random set of points inside a circle of radius 100. Create a voronoi diagram using the points
number_slider_14 = Slider(100, range=0..200)
circle_9 = CircleCNR(Normal=Vector(0, 0, 1), Radius=number_slider_14)
pop2d_2 = Populate2D(Region={Plane=PlaneXY(0, 0, 0), Size=Domain2(u=0..20, v=0..10)}, Count=[circle_9, Slider(50, range=0..100)], Seed=1)
voronoi_2 = Voronoi(Points=pop2d_2, BruteForceOverride=False)

# ----
# Advice: Make sure to set the number sliders to the correct values for the spiral
# Generate a spiral
# Create a spiral that starts with a radius of 4 and ends with a radius of 12.
number_slider_15 = Slider(4, range=0..10)
# Advice: Exception: The JSON value could not be converted to System.String. Path: $.Additions[1].value | LineNumber: 10 | BytePositionInLine: 13.
# Create a spiral that starts with a radius of 4 and ends with a radius of 12 and has 1.5 turns
number_slider_16 = Slider(12, range=0..100)
spiral = Spiral(BasePlane=PlaneXY(0, 0, 0), Angle=0.7853981634, Turns=2, BaseRadius=[number_slider_15, number_slider_16], PeakRadius=1)

# ----
# Advice: Make sure to set the number of points and the rectangle dimensions properly.
# Please make a script that generates a random set of points inside a rectangle of dimensions 100 by 100.
random_3 = Random(Range=Domain(0, 1), Number=1, Seed=2)
rec_4 = Rectangle()
popgeo_2 = PopulateGeometry(Geometry=rec_4, Count=Slider(100, range=0..1000), Seed=random_3)

# ----
# Advice: Make sure to set the number of points to 100
# Create a curve along a spiral. Place 100 points along the spiral.
spiral_2 = Spiral(BasePlane=PlaneXY(0, 0, 0), Angle=0.7853981634, Turns=2, BaseRadius=1, PeakRadius=1)
divide_6 = DivideCurve(Curve=spiral_2, Count=Slider(100, range=0..100), Kinks=False)  # -> Points, Tangents, Parameters

# ----
# Advice: Make sure to use reasonable inputs or the tower will look weird
# Twisty Tower
# Create a 12 sided tower that twists and tapers
Z_2 = UnitZ(Factor=1)
pt_8 = Point(Point(0, 0, 0))
pt_9 = Point(Point(0, 0, 250))
polygon_2 = Polygon(Plane=PlaneXY(0, 0, 0), Radius=3, Segments=Slider(12, range=0..100), FilletRadius=0)  # -> Polygon, Length
ln_2 = Line(StartPoint=pt_8, EndPoint=pt_9)
extr_2 = Extrude(Base=polygon_2.Polygon, Direction=Z_2)
twist_2 = Twist(Geometry=extr_2, Angle=Slider(90, range=0..360), Infinite=False, Rigid=False)
taper = Taper(Geometry=twist_2, Flat=Slider(0.75, range=0..1), Infinite=False, Rigid=False)
join_3 = BrepJoin(Breps=taper)  # -> Breps, Closed

# ----
# Advice: Make sure to set the size and extent parameters for the square grid
# Create a "square grid" of points that is 10 by 10
number_slider_17 = Slider(10, range=0..10)

# ----
# Advice: Make sure to properly set the parameters for the spiral
# Create a spiral that starts with a radius of 4 and ends with a radius of 12 and has 1.5 turns
number_slider_18 = Slider(4, range=0..10)
spiral_3 = Spiral(
    BasePlane=PlaneXY(0, 0, 0),
    Angle=0.7853981634,
    Turns=Slider(1.5, range=0..10),
    BaseRadius=[number_slider_18, Slider(12, range=0..100)],
    PeakRadius=1)

# ----
# Advice: Make sure to properly define the points for each character and connect them in the correct order
# Create a polyline that spells out the characters "A" "E" and "C"
# Letters AEC
pt_10 = Point(Point(0, 0, 0))
pt_11 = Point(Point(10, 0, 0))
pt_12 = Point(Point(5, 10, 0))
pt_13 = Point(Point(15, 10, 0))
pt_14 = Point(Point(20, 0, 0))
pt_15 = Point(Point(30, 0, 0))
pt_16 = Point(Point(25, 10, 0))
pt_17 = Point(Point(35, 10, 0))
pline_3 = PolyLine(Vertices=[pt_10, pt_11, pt_12], Closed=False)
pline_4 = PolyLine(Vertices=[pt_13, pt_14, pt_15], Closed=False)
pline_5 = PolyLine(Vertices=[pt_16, pt_17], Closed=False)

# ----
# Advice: Make sure to set the correct number of points in the grid
# Grid of Points
# Create a grid of points that is 10 by 10
number_slider_19 = Slider(number_slider_17, 10, range=0..10)

# ----
# Advice: Make sure to use reasonable inputs for the radius and number of points
# Please make a script that generates a random set of points inside a circle at (10,10,10) of radius 100. Create a voronoi diagram using the points
circle_10 = CircleCNR(Normal=Vector(0, 0, 1), Radius=1)
number_slider_20 = Slider([number_slider_19, Slider(10, range=0..10)], 500, range=0..1000)
popgeo_3 = PopulateGeometry(Geometry=circle_10, Count=number_slider_20, Seed=1)
voronoi_3 = Voronoi(Points=popgeo_3, BruteForceOverride=False)

# ----
# Draw a polyline that traces the border of the United States.  Let's think this step by step.
# Generate 10 evenly spaced points starting at 0,0,0 and ending at 100,100,0
panel = Panel("Draw a polygon with 6 sides at 0,0,0 with a radius of 12.  Populate the hexagon with 12 random points. Draw a circle at the random points with a random radii between .1 and 1. Let's think through this step by step.")
ghpt = GHPT(Temperature=0.7)  # disabled
# Advice: Make sure to set the proper values for each component
ghpt_2 = GHPT(Prompt=panel, Temperature=0.7)

# ----
# Draw a polyline that traces the border of the United States
# Advice: This question is too complex for me to answer. Please try again.
# Advice: This question is too complex for me to answer. Please try again.
# Advice: Make sure to put the song lyrics in the correct order
# little teapot
# Generate a text tag with the words to the song "I'm a little teapot"
panel_2 = Panel("""I'm a little teapot
Short and stout
Here is my handle
Here is my spout
When I get all steamed up
Hear me shout
Tip me over and pour me out""")
tag = TextTag(Text=panel_2)

pt_18 = Point(Point(0, 0, 0))

# ----
# Advice: Make sure to use the correct number of points and range for the points
# Points along a line
# Generate 10 evenly spaced points starting at 0,0,0 and ending at 100,100,0
pt_19 = Point(Point(0, 0, 0))
# Advice: This question is too complex for me to answer. Please try again.
pt_20 = Point(Point(100, 100, 0))
series_2 = Series(Start=0, Step=Slider(10, range=0..100), Count=Slider(10, range=0..10))
ln_3 = Line(StartPoint=pt_19, EndPoint=pt_20)
divlength = DivideLength(Length=series_2)  # -> Points, Tangents, Parameters

# ----
# Advice: Set the 'Number' input in 'Populate Geometry' for the desired number of random points
# Draw a rectangle at 0,0,0 with a width of 10 and a height of 20.  Populate the rectangle with random points. Draw a line between the center of the rectangle and each random point.
pt_21 = Point(Point(0, 0, 0))
# + Lines to each point
number_slider_21 = Slider(20, range=0..100)
rec_5 = Rectangle([pt_21, Slider(10, range=0..10), number_slider_21])
popgeo_4 = PopulateGeometry(Geometry=rec_5, Count=100, Seed=1)
area = Area(Geometry=rec_5)  # -> Area, Centroid
line = LineSDL(Start=area.Centroid, Direction=popgeo_4, Length=1)

# ----
# Advice: Make sure to adjust the number of random points as needed
# Draw a rectangle at 0,0,0 with a width of 10 and a height of 20.  Populate the rectangle with random points.
pt_22 = Point(Point(0, 0, 0))
rec_6 = Rectangle([pt_22, Slider(10, range=0..10), Slider(20, range=0..100)])
popgeo_5 = PopulateGeometry(Geometry=rec_6, Count=100, Seed=1)

# ----
# Advice: Make sure to set the correct width and height values for the rectangle
# Rectangle
# Draw a rectangle at 0,0,0 with a width of 10 and a height of 20
pt_23 = Point(Point(0, 0, 0))
rec_7 = Rectangle([pt_23, Slider(10, range=0..10), Slider(20, range=0..100)])

# ----
# Draw a polygon with 6 sides at 0,0,0 with a radius of 12.  Populate the hexagon with random points. Draw a line between the center of the rectangle and each random point.
# Advice: Make sure to set the number sliders to the correct value
pt_24 = Point(Point(0, 0, 0))
polygon_3 = Polygon(Plane=PlaneXY(0, 0, 0), Radius=Slider(12, range=0..100), Segments=Slider(6, range=0..10), FilletRadius=0)  # -> Polygon, Length
popgeo_6 = PopulateGeometry(Geometry=polygon_3.Polygon, Count=100, Seed=1)
ln_4 = Line(StartPoint=pt_24, EndPoint=popgeo_6)

# ----
# Advice: Make sure to use reasonable inputs for the random points and radii
# + Circles at each point
polygon_4 = Polygon(Plane=PlaneXY(0, 0, 0), Radius=3, Segments=6, FilletRadius=0)  # -> Polygon, Length
# Draw a polygon with 6 sides at 0,0,0 with a radius of 12.  Populate the hexagon with 12 random points. Draw a circle at the random points with a random radii between .1 and 1.
random_4 = Random(Range=Domain(0, 1), Number=1, Seed=2)
popgeo_7 = PopulateGeometry(Geometry=polygon_4.Polygon, Count=100, Seed=1)
cir = Circle(Plane=popgeo_7, Radius=random_4)

# ----
# Advice: Make sure to set the correct values for the polygon, random points, and random radii
number_slider_22 = Slider(6, range=0..10)
# Advice: This question is too complex for me to answer. Please try again.
# Advice: This question is too complex for me to answer. Please try again.
# USA!
number_slider_23 = Slider(0.1, range=0.1..1)
polygon_5 = Polygon(Plane=number_slider_22, Radius=Slider(12, range=0..100), Segments=6, FilletRadius=0)  # -> Polygon, Length
dom = ConstructDomain(DomainStart=number_slider_23, DomainEnd=1)
popgeo_8 = PopulateGeometry(Geometry=polygon_5.Polygon, Count=Slider(12, range=0..100), Seed=1)
random_5 = Random(Range=Domain(0, 1), Number=1, Seed=2)
cir_2 = Circle(Plane=PlaneXY(0, 0, 0), Radius=random_5)

# ----
# Advice: Ensure the number slider value for the points population is reasonable
# Draw a rectangle at 0,0,0 with a width of 10 and a height of 20.  Populate the rectangle with random points. Draw a line between the center of the rectangle and each random point.
rec_8 = Rectangle()
popgeo_9 = PopulateGeometry(Geometry=rec_8, Count=Slider(100, range=10..1000), Seed=1)
area_2 = Area(Geometry=rec_8)  # -> Area, Centroid
line_2 = LineSDL(Start=area_2.Centroid, Direction=popgeo_9, Length=1)

# ----
# Advice: Remember to set the width and height of the rectangle and control the number of random points
pt_25 = Point(Point(0, 0, 0))
rec_9 = Rectangle(pt_25)
area_3 = Area(Geometry=rec_9)  # -> Area, Centroid
popgeo_10 = PopulateGeometry(Geometry=rec_9, Count=Slider(50, range=10..500), Seed=1)
ln_5 = Line(StartPoint=area_3.Centroid, EndPoint=popgeo_10)

# ----
# Advice: Make sure to properly define the hexagon dimensions and the number of random points
# Advice: Exception: The JSON value could not be converted to System.String. Path: $.Additions[0].value | LineNumber: 6 | BytePositionInLine: 13.
# Try Polygon
pt_26 = Point(Point(0, 0, 0))
popgeo_11 = PopulateGeometry(Geometry=rec_9, Count=Slider(50, range=10..100), Seed=1)
ln_6 = Line(StartPoint=pt_26, EndPoint=popgeo_11)

# ----
# Advice: Make sure to set the radius of the hexagon to 12, and adjust the number of random points as desired
# Draw a hexagon at 0,0,0 with a radius of 12.  Populate the hexagon with random points. Draw a line between the center of the rectangle and each random point.
pt_27 = Point(Point(0, 0, 0))
# Try Hexagon
number_slider_24 = Slider(10, range=1..100)
popgeo_12 = PopulateGeometry(Geometry=rec_9, Count=number_slider_24, Seed=1)
ln_7 = Line(StartPoint=pt_27)

polygon_6 = Polygon(Plane=PlaneXY(0, 0, 0), Radius=Slider(12, range=0..100), Segments=Slider(6, range=0..10), FilletRadius=0)  # -> Polygon, Length
random_6 = Random(Range=Slider(0.1, range=0.1..1), Number=1, Seed=2)
popgeo_13 = PopulateGeometry(Geometry=polygon_6.Polygon, Count=Slider(12, range=0..100), Seed=1)
circle_11 = CircleCNR(Center=popgeo_13, Normal=Vector(0, 0, 1), Radius=random_6)

# ----
# Advice: Make sure to set the correct dimensions and number of points for the desired result
# Please make a script that generates a random set of points inside a rectangle of dimensions 100 by 100. Create a voronoi diagram using the points
# Random Points + Voronoi
rec_10 = Rectangle()

# ----
# Advice: Adjust the seed value and the number of points as desired
# Please make a script that generates a random set of points inside a rectangle of dimensions 100 by 100.
number_slider_25 = Slider(100, range=0..1000)
number_slider_26 = Slider([Slider(50, range=0..100), rec_10], 1, range=0..10)
domain² = Domain²([Slider(100, range=0..100), Slider(100, range=0..100)])
rec_11 = Rectangle(domain²)
pop2d_3 = Populate2D(Region=rec_11, Count=number_slider_25, Seed=number_slider_26)

voronoi_4 = Voronoi(Points=number_slider_26, BruteForceOverride=False)
