# Grasshopper definition PromptTesting_0.2.0.gh (Grasshopper 1.0.7)
# plug-ins: GHPT, GhPolyhedra

# ----
# This request was made and fulfilled after the hard limit had been reached
# Advice: 1. Create a Surface parameter. 2. Connect the List Length component to set the output of the Surface parameter. 3. Connect the output of the List Length component to the A input of an Addition component. 4. Connect a Panel component set to 1 to the B input of the Addition component. 5. Connect the output of the Surface parameter to the input of an Area component. 6. Connect the output of the Area component to the input of a Series component. 7. Connect the output of the Series component to the input of a Text Tag 3D component. 8. Connect the Centroid output of the Area component to the Location input of the Text Tag 3D component.
panel = Panel("""Please make a script to generate a number label on a surface based on the number of surfaces in a list. 
Here are a list of abbreviations this prompt will use: pm is parameter. cm is component. ip  is input. op is output. 

Here are the steps: 
1. make Srf pm
2. ip of list length cm to set op of srf pm .
set A ip of Addition to op of List length cm. Set B ip of Addition to a panel set to 1.
set ip of Area cm to op of Srf pm
set Count ip of Series cm to op of Addition cm
Set Text ip of Text tag 3d cm to op of Series cm 
Set location ip of Text tag 3d cm to Centroid op of Area cm
Please enumerate the steps in the advice panel.""")
ghpt = GHPT(Prompt=panel, Temperature=0.7, CONFIG_INDEX_NAME="GHPT3.5")  # disabled
srf = Surface()
area = Area(Geometry=srf)  # -> Area, Centroid
lng = ListLength(List=srf)
addition = Addition(A=lng)
series = Series(Start=addition, Step=1, Count=10)
tag = TextTag3D(Location=area.Centroid, Text=series, Size=1, Justification=7)

# ----
# This request was made and fulfilled after the hard limit had been reached
# Advice: 1. Create a Surface parameter. 2. Connect the output of a List Length component to the input of the Surface parameter. 3. Connect the output of a Panel component set to 1 to the input of an Addition component. 4. Connect the output of the Surface parameter to the input of an Area component. 5. Connect the output of the Addition component to the input of a Series component. 6. Connect the output of the Series component to the input of a Text Tag 3D component. 7. Connect the output of the Area component to the input of the Centroid component. 8. Connect the output of the Centroid component to the input of the Location parameter of the Text Tag 3D component.
panel_2 = Panel("""Please make a script to generate a number label on a surface based on the number of surfaces in a list. 
Here are a list of abbreviations this prompt will use: pm is parameter. cm is component. ip  is input. op is output. 

Here are the steps: 
1. make Srf pm
2. ip of list length cm to set op of srf pm .
set A ip of Addition to op of List length cm. Set B ip of Addition to a panel set to 1.
set ip of Area cm to op of Srf pm
set Count ip of Series cm to op of Addition cm
Set Text ip of Text tag 3d cm to op of Series cm 
Set location ip of Text tag 3d cm to Centroid op of Area cm
Please enumerate the steps in the advice panel.""")
ghpt_2 = GHPT(Prompt=panel_2, Temperature=0.7, CONFIG_INDEX_NAME="GHPT3.5")  # disabled
lng_2 = ListLength()
addition_2 = Addition(A=lng_2, B="1")
srf_2 = Surface(lng_2)
area_2 = Area(Geometry=srf_2)  # -> Area, Centroid
series_2 = Series(Start=addition_2, Step=1, Count=10)
centroid = Centroid()  # -> Centroid, MedianAB, MedianBC, MedianCA
tag_2 = TextTag3D(Text=series_2, Size=1, Justification=7)

# ----
# Advice: 1. Set the Name input of the Polyhedron component to a panel with the value 'dodecahedron'. 2. Set the Scale input of the Polyhedron component to a slider from 2 to 5. 3. Connect the Curve Output of the Polyhedron component to the Boundary Surfaces component. 4. Set the output of the Boundary Surfaces component to the Evaluate Surface component. 5. Set the Point input of the Evaluate Surface component to the Point {0.5,0.5,0}.
panel_3 = Panel("Please make a dodecahedron by setting the Name input of the Polyhedron component to a panel with the value \"dodecahedron\" and the Scale input of the Polyhedron component to a slider from 2 to 5.  Connect the Curve Output of the Polyhedron component to the Boundary Surfaces component, and set the output of the Boundary Surfaces component to the Evaluate Surface component.  Set the Point input of the Evaluate Surface component to the Point {0.5,0.5,0}.  Please enumerate the steps in this process in the Advice Panel, separated by component.")
ghpt_3 = GHPT(Prompt=panel_3, Temperature=0.7, CONFIG_INDEX_NAME="GHPT3.5")  # disabled
pt = Point(Point(0.5, 0.5, 0))
polyhedron = Polyhedron(Name="dodecahedron", Plane=PlaneXY(0, 0, 0), Scale=Slider(2, range=2..5))  # -> Curves, Meshes, Solid
boundary = BoundarySurfaces()
evalsrf = EvaluateSurface(Surface=[boundary, pt])  # -> Point, Normal, UDirection, VDirection, Frame

# ----
# Code Information: Author:
# Contact:
# 
# Date:
# Project:
# Code Description: Short description of program goals
# Track version changes
# Advice: This question is too complex for me to answer. Please try again.
test_prompt1 = Panel("Can you make a twisty tower with a hexagonal base?")
# GPT 3.5
ghpt_4 = GHPT(Prompt=test_prompt1, Temperature=0.7, CONFIG_INDEX_NAME="GHPT3.5")  # disabled

# ----
# Advice: Make sure to set the sliders to the correct range
test_prompt_2 = Panel("Can you make a cone with a base radius set to a slider from 1-10, and the top set to a slider from 10-20?")
ghpt_5 = GHPT(Prompt=test_prompt_2, Temperature=0.7, CONFIG_INDEX_NAME="GHPT3.5")  # disabled
cir = Circle(Plane=PlaneXY(0, 0, 0), Radius=[Slider(1, range=1..10), Slider(10, range=10..20)])
cone = Cone(Base=PlaneXY(0, 0, 0), Radius=0.5, Length=1)  # -> Cone, Tip

# ----
# Advice: This question is too complex for me to answer. Please try again.
test_prompt_2_2 = Panel("Can you make a twisty tower with a 6-sided base? Please explain step by step how to do this.")
ghpt_6 = GHPT(Prompt=test_prompt_2_2, Temperature=0.7, CONFIG_INDEX_NAME="GHPT3.5")  # disabled

# ----
# Advice: Exception: '.' is invalid within a number, immediately after a decimal point ('.'). Expected a digit ('0'-'9'). Path: $.Additions[1].value | LineNumber: 10 | BytePositionInLine: 14.
test_prompt_2_3 = Panel("Can you make a cone with a radius set to a slider from 1-10, and the height set to a slider from 10-20?")
ghpt_7 = GHPT(Prompt=test_prompt_2_3, Temperature=0.7, CONFIG_INDEX_NAME="GHPT3.5")  # disabled

# ----
# Advice: Exception: '.' is invalid within a number, immediately after a decimal point ('.'). Expected a digit ('0'-'9'). Path: $.Additions[0].value | LineNumber: 6 | BytePositionInLine: 14.
test_prompt_2_4 = Panel("Can you make a cone with a radius set to a slider from 1 to 10, and the height set to a slider from 10 to 20?")
ghpt_8 = GHPT(Prompt=test_prompt_2_4, Temperature=0.7, CONFIG_INDEX_NAME="GHPT3.5")  # disabled

# ----
# Advice: This question is too complex for me to answer. Please try again.
test_prompt1_2 = Panel("Can you make a twisty tower with a hexagonal base? Please enumerate the steps in the Advice panel.")
ghpt_9 = GHPT(Prompt=test_prompt1_2, Temperature=0.7, CONFIG_INDEX_NAME="GHPT3.5")  # disabled

# ----
# Advice: Exception: '.' is invalid within a number, immediately after a decimal point ('.'). Expected a digit ('0'-'9'). Path: $.Additions[0].value | LineNumber: 6 | BytePositionInLine: 14.
test_prompt_2_5 = Panel("Can you make a cone with a base radius set to a slider from 1-10, and the top set to a slider from 10-20?")
ghpt_10 = GHPT(Prompt=test_prompt_2_5, Temperature=0.7, CONFIG_INDEX_NAME="GPT4")  # disabled

# ----
# Advice: Make sure to set your sliders to the correct values for the radius and height of the cone
test_prompt_2_6 = Panel("Can you make a cone with a radius set to a slider from 1-10, and the height set to a slider from 10-20?")
ghpt_11 = GHPT(Prompt=test_prompt_2_6, Temperature=0.7, CONFIG_INDEX_NAME="GPT4")  # disabled
pt_2 = Point(Point(0, 0, 0))
cone_2 = Cone(Base=pt_2, Radius=Slider(1, range=1..10), Length=Slider(10, range=10..20))  # -> Cone, Tip

# ----
# Advice: Make sure to set the correct amount of sides and the right height and twist amount for the tower
test_prompt_2_7 = Panel("Can you make a twisty tower with a 6-sided base? Please explain step by step how to do this.")
ghpt_12 = GHPT(Prompt=test_prompt_2_7, Temperature=0.7, CONFIG_INDEX_NAME="GPT4")  # disabled
Z = UnitZ(Factor=1)
pt_3 = Point(Point(0, 0, 0))
pt_4 = Point(Point(0, 0, 250))
number_slider = Slider(6, range=0..10)
# GPT 4
polygon = Polygon(Plane=PlaneXY(0, 0, 0), Radius=3, Segments=6, FilletRadius=0)  # -> Polygon, Length
ln = Line(StartPoint=pt_3, EndPoint=pt_4)
extr = Extrude(Base=polygon.Polygon, Direction=Z)
twist = Twist(Geometry=extr, Axis=ln, Angle=Slider(90, range=0..360), Infinite=False, Rigid=False)
sunion = SolidUnion(Breps=twist)
join = BrepJoin(Breps=sunion)  # -> Breps, Closed

# ----
# Advice: Exception: '.' is invalid within a number, immediately after a decimal point ('.'). Expected a digit ('0'-'9'). Path: $.Additions[1].value | LineNumber: 10 | BytePositionInLine: 14.
test_prompt_2_8 = Panel("Can you make a cone with a radius set to a slider from 1 to 10, and the height set to a slider from 10 to 20?")
ghpt_13 = GHPT(Prompt=test_prompt_2_8, Temperature=0.7, CONFIG_INDEX_NAME="GPT4")  # disabled

# ----
# Advice: Exception: '"' is invalid after a value. Expected either ',', '}', or ']'. Path: $.Additions[5] | LineNumber: 27 | BytePositionInLine: 3.
test_prompt1_3 = Panel("Can you make a twisty tower with a hexagonal base? Please enumerate the steps in the Advice panel.")
ghpt_14 = GHPT(Prompt=test_prompt1_3, Temperature=0.7, CONFIG_INDEX_NAME="GPT4")  # disabled
